# Grasshopper definition MeshSim_Test1_FunCube.gh (Grasshopper 1.0.7)
# plug-ins: OmniGrasshopperTest

number_slider = Slider(48, range=0..100)
construct_point = ConstructPoint(XCoordinate=Slider(0, range=0..1000), YCoordinate=Slider(25, range=0..1000), ZCoordinate=Slider(197, range=0..1000))
number_slider_2 = Slider(50, range=0..1000)
center_box = CenterBox(Base=construct_point, X=number_slider, Y=number_slider, Z=number_slider)
mesh_box = MeshBox(Base=center_box, XCount=number_slider_2, YCount=number_slider_2, ZCount=number_slider_2)
deconstruct_mesh = DeconstructMesh(Mesh=mesh_box)  # -> Vertices, Faces, Colours, Normals
deconstruct = Deconstruct(Point=deconstruct_mesh.Vertices)  # -> XComponent, YComponent, ZComponent
sort_list = SortList(Keys=deconstruct.ZComponent)  # -> Keys, ValuesA
sort_list_2 = SortList(Keys=deconstruct.XComponent)  # -> Keys, ValuesA
sort_list_3 = SortList(Keys=deconstruct.YComponent)  # -> Keys, ValuesA
list_item = ListItem(List=sort_list_2.Keys, Index=0, Wrap=True)
list_item_2 = ListItem(List=sort_list_3.Keys, Index=0, Wrap=True)
list_item_3 = ListItem(List=sort_list.Keys, Index=0, Wrap=True)
construct_point_2 = ConstructPoint(XCoordinate=list_item, YCoordinate=list_item_2, ZCoordinate=list_item_3)
distance = Distance(PointA=deconstruct_mesh.Vertices, PointB=construct_point_2)
sort_list_4 = SortList(Keys=distance)  # -> reverse(Keys), ValuesA
list_item_4 = ListItem(List=sort_list_4.Keys, Index=0, Wrap=True)
gradient = Gradient(
    LowerLimit=0,
    UpperLimit=list_item_4,
    Parameter=distance,
    stops=[0: RGB(243, 57, 0), 0.1: RGB(236, 27, 60), 0.205: RGB(210, 0, 118), 0.4: RGB(39, 72, 161), 0.41: RGB(103, 0, 120), 0.6: RGB(18, 178, 90), 0.639: RGB(1, 192, 229), 0.7: RGB(79, 186, 8), 0.8: RGB(220, 237, 32), 0.9: RGB(247, 159, 20), 1: RGB(243, 57, 0)])

# ---- group: Data
number = Number(distance)
panel = Panel(number)

# ---- group: Data / Fake Data
list_length = ListLength(List=number)
series = Series(Start=0, Step=1, Count=list_length)

# ----
series_2 = Series(Start="0", Step=1, Count="24")

# ---- group: 原Mesh上色不可，必须用上色过后的Mesh
mesh = Mesh(mesh_box)

# ----
construct_mesh = ConstructMesh(Vertices=deconstruct_mesh.Vertices, Faces=deconstruct_mesh.Faces, Colours=gradient)
deconstruct_mesh_2 = DeconstructMesh(Mesh=construct_mesh)  # -> Vertices, Faces, Colours, Normals
duplicate_data = DuplicateData(Data=series, Number="24", Order=True)  # -> simplify(Data)
duplicate_data_2 = DuplicateData(Data=deconstruct_mesh_2.Colours, Number="24", Order=True)  # -> simplify(Data)
duplicate_data_3 = DuplicateData(Data=deconstruct_mesh_2.Vertices, Number="24", Order=True)  # -> simplify(Data)
partition_list = PartitionList(List=duplicate_data, Size=list_length)  # -> simplify(Chunks)
partition_list_2 = PartitionList(List=duplicate_data_2, Size=list_length)  # -> simplify(Chunks)
partition_list_3 = PartitionList(List=duplicate_data_3, Size=list_length)  # -> simplify(Chunks)

omnimeshsimexporter = OmniMeshSimExporter(
    Mesh=construct_mesh,
    Colors=partition_list_2,
    Points=partition_list_3,
    Data=partition_list,
    Timestamps=series_2,
    LayerName="CubeTest",
    Units="Cube01",
    objectID=112145310)

param_viewer = ParamViewer(partition_list_3)
panel_2 = Panel(omnimeshsimexporter)
omnibrowser = OmniBrowser(BrowseOperand=True, SignInOperand=True, objectID=112139144)  # -> ActiveServer, ProjectPropPath, ChildName
omnigrasshopper = OmniGrasshopper(
    OmniInput=omnimeshsimexporter,
    ProjectPropPath=omnibrowser.ProjectPropPath,
    ChildName=omnibrowser.ChildName,
    PropOperand=True,
    PublishOperand=False,
    SendToViewOperand=False)
