# Grasshopper definition MeshSim_Test2_TwistedBox.gh (Grasshopper 1.0.7)
# plug-ins: OmniGrasshopperTest

radians = Radians(Degrees=Slider(94, range=0..360))
curve = Curve(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)
geometry = Geometry(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)
twist = Twist(Geometry=geometry, Axis=curve, Angle=radians, Infinite=False, Rigid=False)
unit_x = UnitX(Factor=Slider(666, range=0..1000))
unit_y = UnitY(Factor=Slider(376, range=0..1000))
move = Move(Geometry=twist, Motion=unit_x)  # -> Geometry, Transform
move_2 = Move(Geometry=move.Geometry, Motion=unit_y)  # -> Geometry, Transform
unit_z = UnitZ(Factor=Slider(0, range=0..1000))
move_3 = Move(Geometry=move_2.Geometry, Motion=unit_z)  # -> Geometry, Transform
radians_2 = Radians(Degrees=Slider(0, range=0..360))
rotate = Rotate(Geometry=move_3.Geometry, Angle=radians_2, Plane=PlaneXY(0, 0, 0))  # -> Geometry, Transform
deconstruct_brep = DeconstructBrep(Brep=rotate.Geometry)  # -> Faces, Edges, Vertices
number_slider = Slider(5, range=0..6)
list_item = ListItem(List=deconstruct_brep.Faces, Index=number_slider, Wrap=True)
cull_index = CullIndex(List=deconstruct_brep.Faces, Indices=number_slider, Wrap=True)
brep_join = BrepJoin(Breps=cull_index)  # -> Breps, Closed
mesh_brep = MeshBrep(
    Brep=brep_join.Breps,
    Settings={GridMaxCount=0, GridMinCount=16, JaggedSeams=False, MaxEdgeLength=0, MinEdgeLength=0.0001, MinTolerance=0, Refine=True, RefineAngle=0, RelativeTolerance=0.65, SimplePlanes=True, Tolerance=0})
scale = Scale(Geometry=mesh_brep, Center=Point(0, 0, 0), Factor=Slider(1.5, range=1..2))  # -> Geometry, Transform
merge = Merge(Data1=mesh_brep, Data2=scale.Geometry)  # -> simplify(Result)
panel = Panel(merge)
deconstruct_mesh = DeconstructMesh(Mesh=merge)  # -> Vertices, Faces, Colours, Normals
list_item_2 = ListItem(List=deconstruct_mesh.Vertices, Index=0, Wrap=True)
distance = Distance(PointA=list_item_2, PointB=deconstruct_mesh.Vertices)  # -> reverse(simplify(Distance))
sort_list = SortList(Keys=distance)  # -> Keys, ValuesA
list_item_3 = ListItem(List=sort_list.Keys, Index="-1", Wrap=True)
tree_branch = TreeBranch(Tree=distance, Path="0", MaintainPaths=True)
tree_branch_2 = TreeBranch(Tree=list_item_3, Path="1", MaintainPaths=True)
tree_branch_3 = TreeBranch(Tree=list_item_3, Path="0", MaintainPaths=True)
tree_branch_4 = TreeBranch(Tree=distance, Path="1", MaintainPaths=True)
gradient = Gradient(
    LowerLimit=0,
    UpperLimit=tree_branch_3,
    Parameter=tree_branch,
    stops=[0.0167: RGB(243, 57, 0), 0.0922: RGB(236, 27, 60), 0.2: RGB(210, 0, 118), 0.3: RGB(103, 0, 120), 0.4: RGB(39, 72, 161), 0.5: RGB(1, 192, 229), 0.6: RGB(18, 178, 90), 0.7: RGB(79, 186, 8), 0.8: RGB(220, 237, 32), 0.9: RGB(247, 159, 20), 1: RGB(243, 57, 0)])
gradient_2 = Gradient(
    LowerLimit=0,
    UpperLimit=tree_branch_2,
    Parameter=tree_branch_4,
    stops=[0.1: RGB(255, 255, 255), 0.2: RGB(0, 0, 0), 0.3: RGB(255, 255, 255), 0.4: RGB(0, 0, 0), 0.5: RGB(255, 255, 255), 0.6: RGB(0, 0, 0), 0.7: RGB(255, 255, 255), 0.8: RGB(0, 0, 0), 0.9: RGB(255, 255, 255)])
tree_branch_5 = TreeBranch(Tree=simplify(deconstruct_mesh.Vertices), Path="0", MaintainPaths=True)
tree_branch_6 = TreeBranch(Tree=simplify(deconstruct_mesh.Vertices), Path="1", MaintainPaths=True)
tree_branch_7 = TreeBranch(Tree=simplify(deconstruct_mesh.Faces), Path="1", MaintainPaths=True)
tree_branch_8 = TreeBranch(Tree=simplify(deconstruct_mesh.Faces), Path="0", MaintainPaths=True)
construct_mesh = ConstructMesh(Vertices=tree_branch_6, Faces=tree_branch_7, Colours=gradient_2)
construct_mesh_2 = ConstructMesh(Vertices=tree_branch_5, Faces=tree_branch_8, Colours=gradient)
entwine = Entwine(Branch00=tree_branch_5, Branch01=tree_branch_6, FlattenInputs=True)  # -> simplify(Result)
merge_2 = Merge(Data1=construct_mesh, Data2=construct_mesh_2)  # -> flatten(Result)
list_length = ListLength(List=merge_2)
series = Series(Start=0, Step="100", Count=list_length)

# ---- group: Colors
entwine_2 = Entwine(Branch00=gradient, Branch01=gradient_2, FlattenInputs=True)  # -> simplify(Result)

# ---- group: Points
entwine_3 = Entwine(Branch00=tree_branch_5, Branch01=tree_branch_6, FlattenInputs=True)  # -> simplify(Result)

# ---- group: Data
entwine_4 = Entwine(Branch00=tree_branch, Branch01=tree_branch_4, FlattenInputs=True)  # -> simplify(Result)

# ----
mass_addition = MassAddition(Input=entwine_4)  # -> Result, PartialResults
replace_items = ReplaceItems(List=entwine_4, Item=mass_addition.Result, Indices="-1", Wrap=True)
omnibrowser = OmniBrowser(BrowseOperand=True, SignInOperand=True, objectID=144550278)  # -> ActiveServer, ProjectPropPath, ChildName
omnimeshsimexporter = OmniMeshSimExporter(
    Mesh=merge_2,
    Colors=entwine_2,
    Points=entwine_3,
    Data=replace_items,
    Timestamps=series,
    LayerName="PersonalTest_",
    Units="Dist",
    objectID=144541638)
panel_2 = Panel(omnimeshsimexporter)
omnigrasshopper = OmniGrasshopper(
    OmniInput=omnimeshsimexporter,
    ProjectPropPath=omnibrowser.ProjectPropPath,
    ChildName=omnibrowser.ChildName,
    PropOperand=True,
    PublishOperand=False,
    SendToViewOperand=False)
