# Grasshopper definition MeshSim_Test3_Kangaroo.gh (Grasshopper 1.0.7)
# plug-ins: Kangaroo2 Components, OmniGrasshopperTest

# OmniMeshSimExporter Kangaroo Example
number_slider = Slider(100, range=0..100)
# To use this grasshopper script, follow the following steps:
# 1) In the SOLVE area, ensure that the 'Solver Toggle' is set to 'True' and is enabled
# (if it is faded, it is not enabled). Also ensure that the 'Solver Clock' is currently
# paused (you should see a play button if it is currently paused).
# 2) Clear any recorded data in the recorder in the 'Data Cleanup and Recording' area.
# 3) Set the 'Solver Toggle' in the SOLVE area to 'False'. You should now see one data
# point recorded in the panel in the 'Data Cleanup and Recording' area. Now, set the 'Solver
# Toggle' to 'True' again. You should see two data points in the panel.
# 4) In the SOLVE area, click the play button on the 'Solver Clock'. This will disable the
# 'Solver Toggle', which will need to be re-enabled when recording a new simulation.
# 5) Allow the solver to run until 30-40 data points have been collected or until a desired
# stopping point has been reached. You can view the state of the simulation in the Rhino
# Viewport by clicking the 'Step Solver' component.
# 6) Click the pause button on the 'Solver Clock' to stop the simulation.
# 7) Export to Omniverse using the final OmniGrasshopper component.
# Start with a Polygon
polygon = Polygon(Plane=PlaneXY(0, 0, 0), Radius=number_slider, Segments=Slider(5, range=0..10), FilletRadius=0)  # -> Polygon, Length
explode = Explode(Curve=polygon.Polygon, Recursive=True)  # -> Segments, Vertices

# ----
# Mesh Setup
# Careful: Changing the level will
# cause a LOT of recomputing.
polygon_center = PolygonCenter(Polyline=polygon.Polygon)  # -> CenterV, CenterE, CenterA
boundary_surfaces = BoundarySurfaces(Edges=polygon.Polygon)
curve_middle = CurveMiddle(Curve=explode.Segments)
line = Line(StartPoint=polygon_center.CenterV, EndPoint=curve_middle)
surface_split = SurfaceSplit(Surface=boundary_surfaces, Curves=line)
brep_join = BrepJoin(Breps=surface_split)  # -> Breps, Closed
mesh = Mesh(brep_join.Breps)
refine = Refine(Mesh=mesh, Level=Slider(3, range=1..5))

end_points = EndPoints(Curve=explode.Segments)  # -> Start, End

# ----
# Goal Object Setup
# Sets up Vertical Load Goal on each vertex
# Sets up Edge Length Goal for mesh
# Show Goal Needed for Mesh Output
# Ensures the corners of the mesh
# are anchored to the ground
number_slider_2 = Slider(1, range=0..10)
deconstruct_mesh = DeconstructMesh(Mesh=refine)  # -> Vertices, Faces, Colours, Normals
edgelengths = EdgeLengths(Mesh=refine, LengthFactor=Slider(1, range=0..1), Strength=number_slider_2)
anchor = Anchor(Point=end_points.Start, Strength=10000)
show = Show(G=refine)
unit_z = UnitZ(Factor=Slider(0.07, range=0..0.1))
load = Load(Point=deconstruct_mesh.Vertices, ForceVector=unit_z, Weighting=1)
entwine = Entwine(Branch00=load, Branch01=edgelengths, Branch02=anchor, Branch03=show, FlattenInputs=True)

# ----
# SOLVE
# Right click and click "Enabled" to enable.
# Solver Toggle
# Solver Clock
number_slider_3 = Slider(10, range=0..10)
trigger = Timer(Interval=-200, TimerInterval=200, Target=boolean_toggle)
boolean_toggle = BooleanToggle(True)
stepsolver = StepSolver(GoalObjects=entwine, Tolerance=0.01, Momentum=False, Damping=0.99, SubIterations=number_slider_3, Animate=boolean_toggle)  # -> I, V, reverse(O)

list_item = ListItem(List=stepsolver.O, Index=0, Wrap=True)

# ----
# Data Cleanup and Recording
# Use this panel to view recorded data textually
# Clear this by pressing the X
mesh_2 = Mesh(list_item)
clean_tree = CleanTree(RemoveNulls=True, RemoveInvalid=True, RemoveEmpty=False, Tree=mesh_2)
move = Move(Geometry=clean_tree, Motion=Vector(0, 0, 0.25))  # -> Geometry, Transform
data_recorder = DataRecorder(move.Geometry, DataLimit=-10, RecordData=True)
panel = Panel(data_recorder)

panel_2 = Panel(mesh_2)
deconstruct_mesh_2 = DeconstructMesh(Mesh=data_recorder)  # -> Vertices, Faces, Colours, Normals

# ----
# Curvature Estimation
patch = Patch(Points=deconstruct_mesh_2.Vertices, Spans=20, Flexibility=1, Trim=True)
surface_closest_point = SurfaceClosestPoint(Point=deconstruct_mesh_2.Vertices, Surface=patch)  # -> Point, UVPoint, Distance
surface_curvature = SurfaceCurvature(Surface=patch, Point=surface_closest_point.UVPoint)  # -> Frame, simplify(Gaussian), Mean

# ---- group: Fake Data
list_length = ListLength(List=data_recorder)
tree_branch = TreeBranch(Tree=surface_curvature.Gaussian, Path="0", MaintainPaths=True)
series = Series(Start=0, Step=1, Count=flatten(list_length))  # -> simplify(graft(Series))
list_length_2 = ListLength(List=tree_branch)
duplicate_data = DuplicateData(Data=series, Number=list_length_2, Order=True)  # -> simplify(Data)

# ----
panel_4 = Panel(surface_curvature.Gaussian)

# ----
# Color Evaluation
bounds = Bounds(Numbers=surface_curvature.Gaussian)
deconstruct_domain = DeconstructDomain(Domain=bounds)  # -> Start, End
gradient = Gradient(
    LowerLimit=deconstruct_domain.Start,
    UpperLimit=deconstruct_domain.End,
    Parameter=surface_curvature.Gaussian,
    stops=[0: RGB(234, 38, 0), 0.25: RGB(234, 126, 0), 0.5: RGB(254, 244, 84), 0.75: RGB(173, 203, 249), 1: RGB(75, 107, 169)])
simplify_tree = SimplifyTree(Tree=gradient, Front=False)

simplify_tree_2 = SimplifyTree(Tree=surface_curvature.Gaussian, Front=False)
panel_5 = Panel("1")
panel_6 = Panel("2")
param_viewer = ParamViewer(duplicate_data)
param_viewer_2 = ParamViewer(simplify_tree_2)
construct_mesh = ConstructMesh(Vertices=deconstruct_mesh_2.Vertices, Faces=deconstruct_mesh_2.Faces, Colours=simplify_tree)  # -> flatten(Mesh)

# ----
# Timestamp Setup
number_slider_4 = Slider(10, range=0..100)
list_length_3 = ListLength(List=data_recorder)
series_2 = Series(Start=0, Step=number_slider_4, Count=list_length_3)  # -> simplify(Series)

param_viewer_3 = ParamViewer(simplify_tree)
param_viewer_4 = ParamViewer(construct_mesh)
param_viewer_5 = ParamViewer(series_2)
panel_7 = Panel(series_2)

# ----
# Timestamp Viewer
# Click to view simulation
# in Rhino Viewport!
# Select the desired point in the simulation
# (will snap to the nearest time sample)
timestamp = Slider(0.54, range=0..1)
list_length_4 = ListLength(List=construct_mesh)  # -> expr("x-1", Length)
multiplication = Multiplication(A=timestamp, B=list_length_4)
list_item_2 = ListItem(List=construct_mesh, Index=multiplication, Wrap=True)
simulation_view = Mesh(list_item_2)

omnibrowser = OmniBrowser(BrowseOperand=True, SignInOperand=True, objectID=9123455)  # -> ActiveServer, ProjectPropPath, ChildName

# ----
# Simulation Export
panel_8 = Panel("SimulationLayer")
simexp = OmniSimExporter(
    Mesh=construct_mesh,
    Colors=simplify_tree,
    Points=deconstruct_mesh_2.Vertices,
    Data=duplicate_data,
    Timestamps=series_2,
    LayerName=panel_8,
    Units="Curviness",
    objectID=151635556)
omnigrasshopper = OmniGrasshopper(
    OmniLayer=simexp,
    ProjectFolderPATH=omnibrowser.ProjectPropPath,
    FileName=omnibrowser.ChildName,
    PropOperand=True,
    PublishOperand=False,
    SendToViewOperand=False)

panel_9 = Panel(omnibrowser.ProjectPropPath)
