# Grasshopper definition MeshSim_Test4_BerlinLadybug.gh (Grasshopper 1.0.7)
# plug-ins: LunchBox, OmniGrasshopperTest

size_selection = Slider(1, range=0..2)

_1960x990 = Panel("""87
225""")
_1150x1500 = Panel("""150
150""")
_990x1960 = Panel("""175
115""")
entwine = Entwine(Branch00=_990x1960, Branch01=_1960x990, Branch02=_1150x1500, FlattenInputs=True)  # -> simplify(Result)
tree_branch = TreeBranch(Tree=entwine, Path=size_selection, MaintainPaths=True)
list_item = ListItem(List=tree_branch, Index="0", Wrap=True)
list_item_2 = ListItem(List=tree_branch, Index="1", Wrap=True)

geometry = Geometry(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)
quad_panels = QuadPanels(Surface=geometry, UDivisions=list_item, VDivisions=list_item_2)
brep_brep = BrepBrep(BrepA=geometry, BrepB=quad_panels)  # -> simplify(Curves), Points
panel = Panel(quad_panels)
clean_tree = CleanTree(RemoveNulls=True, RemoveInvalid=True, RemoveEmpty=True, Tree=brep_brep.Curves)  # -> simplify(Tree)
flatten_tree = FlattenTree(Tree=clean_tree, Path="{0}")
surface = Surface(flatten_tree)
height = Slider(0.9, range=0.1..1)
area = Area(Geometry=surface)  # -> Area, Centroid
unit_z = UnitZ(Factor=height)
h_degree = Slider(0, range=0..360)
scale = Scale(Geometry=surface, Center=area.Centroid, Factor=Slider(0.95, range=0..1))  # -> Geometry, Transform
panel_2 = Panel("0")
move = Move(Geometry=scale.Geometry, Motion=unit_z)  # -> Geometry, Transform
radians = Radians(Degrees=h_degree)
rotate = Rotate(Geometry=move.Geometry, Angle=radians, Plane=area.Centroid)  # -> Geometry, Transform

# ---- group: PANEL SIZE
list_item_3 = ListItem(List=rotate.Geometry, Index=Slider(100, range=0..100), Wrap=True)
deconstruct_brep = DeconstructBrep(Brep=list_item_3)  # -> Faces, Edges, Vertices
panel_3 = Panel("""0
1""")
list_item_4 = ListItem(List=deconstruct_brep.Edges, Index=panel_3, Wrap=True)
area_2 = Area(Geometry=list_item_3)  # -> Area, Centroid
length = Length(Curve=list_item_4)
# 1960X990
panel_4 = Panel(length)
panel_5 = Panel(area_2.Area)

# ----
v_degree = Slider(104, range=0..360)
panel_6 = Panel(rotate.Geometry)
area_3 = Area(Geometry=rotate.Geometry)  # -> Area, Centroid

# ---- group: Get Axises
list_length = ListLength(List=brep_brep.Curves)
larger_than = LargerThan(FirstNumber=list_length, SecondNumber="0")  # -> LargerThan, OrEqualTo
graft_tree = GraftTree(Tree=quad_panels, IncludeEmptyLists=True, IncludeNullItems=True)  # -> simplify(Tree)
dispatch = Dispatch(List=graft_tree, DispatchPattern=larger_than.LargerThan)  # -> ListA, ListB
geometry_2 = Geometry(flatten(dispatch.ListA))
deconstruct_brep_2 = DeconstructBrep(Brep=geometry_2)  # -> Faces, Edges, Vertices
list_item_5 = ListItem(List=deconstruct_brep_2.Edges, Index="1", Wrap=True)
list_item_6 = ListItem(List=deconstruct_brep_2.Edges, Index="3", Wrap=True)
curve_middle = CurveMiddle(Curve=list_item_5)
curve_middle_2 = CurveMiddle(Curve=list_item_6)
line = Line(StartPoint=curve_middle, EndPoint=curve_middle_2)
curve_middle_3 = CurveMiddle(Curve=line)  # -> simplify(flatten(Midpoint))
vector_2pt = Vector2Pt(PointA=curve_middle_3, PointB=area_3.Centroid, Unitize=False)  # -> Vector, Length
move_2 = Move(Geometry=flatten(line), Motion=vector_2pt.Vector)  # -> Geometry, Transform
curve_middle_4 = CurveMiddle(Curve=move_2.Geometry)
rotate_2 = Rotate(Geometry=move_2.Geometry, Angle=h_degree, Plane=curve_middle_4)  # -> Geometry, Transform

# ----
radians_2 = Radians(Degrees=v_degree)

# ---- group: ALL VERTICAL
rotate_3d = Rotate3D(Geometry=rotate.Geometry, Angle=radians_2, Center=area_3.Centroid, Axis=rotate_2.Geometry)  # -> Geometry, Transform

# ----
area_4 = Area(Geometry=rotate_3d.Geometry)  # -> Area, Centroid
sort_list = SortList(Keys=area_4.Area, ValuesValuesA=rotate_3d.Geometry)  # -> Keys, ValuesValuesA
list_item_7 = ListItem(List=sort_list.ValuesValuesA, Index="-1", Wrap=True)
area_5 = Area(Geometry=list_item_7)  # -> Area, Centroid
area_6 = Area(Geometry=sort_list.ValuesValuesA)  # -> Area, Centroid
multiplication = Multiplication(A=area_5.Area, B=Slider(0.9, range=0..1))
smaller_than = SmallerThan(FirstNumber=multiplication, SecondNumber=area_6.Area)  # -> SmallerThan, OrEqualTo
dispatch_2 = Dispatch(List=sort_list.ValuesValuesA, DispatchPattern=smaller_than.SmallerThan)  # -> ListA, ListB
geometry_3 = Geometry(dispatch_2.ListB)

# ---- group: Remove Small Panels
geometry_4 = Geometry(dispatch_2.ListA)

# ----
panel_7 = Panel(geometry_4)
area_7 = Area(Geometry=geometry_4)  # -> Area, Centroid
deconstruct_vector = DeconstructVector(Vector=area_7.Centroid)  # -> XComponent, YComponent, ZComponent
sort_list_2 = SortList(Keys=deconstruct_vector.YComponent, ValuesValuesA=geometry_4)  # -> Keys, ValuesValuesA
panel_8 = Panel(sort_list_2.Keys)
round = Round(Number=sort_list_2.Keys)  # -> Nearest, Floor, Ceiling
create_set = CreateSet(List=round.Nearest)  # -> Set, Map
panel_9 = Panel(round.Nearest)
item_index = ItemIndex(List=round.Nearest, Item=create_set.Set)

# ---- group: Accurate
cull_index = CullIndex(List=item_index, Indices="-2", Wrap=True)

# ----
split_list = SplitList(List=cull_index, Index="1")  # -> simplify(ListA), simplify(ListB)
subtraction = Subtraction(A=split_list.ListB, B="1")
merge = Merge(Data1=split_list.ListA, Data2=subtraction)
panel_10 = Panel(merge)
number = Number(merge)
shift_list = ShiftList(List=number, Shift=1, Wrap=True)
split_list_2 = SplitList(List=number, Index="1")  # -> simplify(ListA), simplify(ListB)
list_length_2 = ListLength(List=shift_list)  # -> expr("x-1", Length)
addition = Addition(A=split_list_2.ListB, B="1")
list_length_3 = ListLength(List=sort_list_2.ValuesValuesA)  # -> expr("x-1", Length)
split_list_3 = SplitList(List=shift_list, Index=list_length_2)  # -> simplify(ListA), simplify(ListB)
merge_2 = Merge(Data1=split_list_2.ListA, Data2=addition)
merge_3 = Merge(Data1=simplify(flatten(split_list_3.ListA)), Data2=list_length_3)
construct_domain = ConstructDomain(DomainStart=merge_2, DomainEnd=merge_3)

# ---- group: 按照垂直于太阳方向进行每排分组
sub_list = SubList(List=sort_list_2.ValuesValuesA, Domain=construct_domain, Wrap=True)  # -> simplify(List), Index

# ----
list_item_8 = ListItem(List=sort_list_2.ValuesValuesA, Index="48", Wrap=True)
tree_branch_2 = TreeBranch(Tree=sub_list.List, Path=Slider(0, range=0..100), MaintainPaths=True)
tree_statistics = TreeStatistics(Tree=sub_list.List)  # -> Paths, Length, Count
unit_z_2 = UnitZ(Factor=1)
tree = Slider(1, range=0..3)

全排 = Panel("1")
两排一并 = Panel("""1
0
1""")
一排一并 = Panel("""1
0""")
两排一并_2 = Panel("""1
1
0""")
entwine_2 = Entwine(Branch00=全排, Branch01=一排一并, Branch02=两排一并_2, Branch03=两排一并, FlattenInputs=True)  # -> simplify(Result)
panel_11 = Panel(entwine_2)
tree_branch_3 = TreeBranch(Tree=entwine_2, Path=tree, MaintainPaths=True)

panel_12 = Panel("""0.4
0.015""")
series = Series(Start=Slider(0, range=0..0.4), Step=Slider(0.01, range=0..0.02), Count=tree_statistics.Count)
amplitude = Amplitude(Vector=unit_z_2, Amplitude=series)  # -> graft(Vector)
panel_13 = Panel(sub_list.List)
panel_14 = Panel(series)

# ---- group: 高度渐变阵列
move_3 = Move(Geometry=sub_list.List, Motion=amplitude)  # -> simplify(Geometry), Transform

# ----
tree_statistics_2 = TreeStatistics(Tree=move_3.Geometry)  # -> Paths, Length, Count
series_2 = Series(Start=0, Step=1, Count=tree_statistics_2.Count)
cull_pattern = CullPattern(List=series_2, CullPattern=tree_branch_3)

# ---- group: 几排一并阵列
tree_branch_4 = TreeBranch(Tree=move_3.Geometry, Path=cull_pattern, MaintainPaths=True)

# ---- group: Axis
list_item_9 = ListItem(List=tree_branch_4, Index=Slider(6, range=0..10), Wrap=True)
deconstruct_brep_3 = DeconstructBrep(Brep=list_item_9)  # -> Faces, Edges, Vertices
list_item_10 = ListItem(List=deconstruct_brep_3.Edges, Index="1", Wrap=True)
list_item_11 = ListItem(List=deconstruct_brep_3.Edges, Index="3", Wrap=True)
curve_middle_5 = CurveMiddle(Curve=list_item_11)
curve_middle_6 = CurveMiddle(Curve=list_item_10)
line_2 = Line(StartPoint=curve_middle_6, EndPoint=curve_middle_5)
area_8 = Area(Geometry=tree_branch_4)  # -> Area, Centroid
curve_middle_7 = CurveMiddle(Curve=line_2)  # -> simplify(Midpoint)
vector_2pt_2 = Vector2Pt(PointA=curve_middle_7, PointB=area_8.Centroid, Unitize=False)  # -> Vector, Length
move_4 = Move(Geometry=line_2, Motion=vector_2pt_2.Vector)  # -> simplify(Geometry), Transform

# ----
panel_15 = Panel(cull_pattern)
angle0 = Slider(76, range=0..360)
panel_16 = Panel("76")
tree_statistics_3 = TreeStatistics(Tree=tree_branch_4)  # -> Paths, Length, Count
panel_17 = Panel(tree_statistics_3.Count)
division = Division(A=angle0, B=tree_statistics_3.Count)
radians_3 = Radians(Degrees=angle0)
negative = Negative(Value=division)

# ---- group: Rotate0
rotate_axis = RotateAxis(Geometry=tree_branch_4, Angle=radians_3, Axis=move_4.Geometry)  # -> Geometry, Transform

# ----
radians_4 = Radians(Degrees=negative)
multiplication_2 = Multiplication(A=radians_4, B="1.3")
angle = Slider(0.8, range=0..1)
construct_domain_2 = ConstructDomain(DomainStart="0", DomainEnd=multiplication_2)
construct_domain_3 = ConstructDomain(DomainStart="0", DomainEnd="1")

merge_4 = Merge(
    Data1=ColourSwatch(SwatchColor=RGB(39, 72, 161)),
    Data2=ColourSwatch(SwatchColor=RGB(1, 192, 229)),
    Data3=ColourSwatch(SwatchColor=RGB(18, 178, 90)),
    Data4=ColourSwatch(SwatchColor=RGB(79, 186, 8)),
    Data5=ColourSwatch(SwatchColor=RGB(220, 237, 32)),
    Data6=ColourSwatch(SwatchColor=RGB(247, 159, 20)),
    Data7=ColourSwatch(SwatchColor=RGB(206, 45, 118)),
    Data8=ColourSwatch(SwatchColor=RGB(103, 0, 120)),
    Data9=ColourSwatch(SwatchColor=RGB(236, 27, 60)),
    Data10=ColourSwatch(SwatchColor=RGB(243, 57, 0)))

remap_numbers = RemapNumbers(Value=angle, Source=construct_domain_3, Target=construct_domain_2)  # -> Mapped, Clipped
series_3 = Series(Start=0, Step=remap_numbers.Mapped, Count=tree_statistics_3.Count)  # -> simplify(graft(Series))
panel_18 = Panel(remap_numbers.Mapped)
legendpar = LBLegendParameters(colors=merge_4)  # -> leg_par; plug-in component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

# ---- group: 角度渐变阵列
rotate_axis_2 = RotateAxis(Geometry=rotate_axis.Geometry, Angle=series_3, Axis=move_4.Geometry)  # -> Geometry, Transform

# ----
file_path = FilePath("C:\Users\hec\Desktop\EPW FILE\DEU_Berlin.103840_IWEC.epw")
importepw = LBImportEPW(epw_file=file_path)  # -> location, dry_bulb_temperature, dew_point_temperature, relative_humidity, wind_speed, wind_direction, direct_normal_rad, diffuse_horizontal_rad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; plug-in component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
flatten_tree_2 = FlattenTree(Tree=rotate_axis_2.Geometry, Path="{0}")
area_9 = Area(Geometry=flatten_tree_2)  # -> Area, Centroid
evaluate_surface = EvaluateSurface(Surface=flatten_tree_2, Point=area_9.Centroid)  # -> Point, Normal, UDirection, VDirection, Frame
analysisperiod = LBAnalysisPeriod(start_month="12", start_day="21", start_hour="7", end_month="12", end_day="21", end_hour="7")  # -> period, hoys, dates; plug-in component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
amplitude_2 = Amplitude(Vector=evaluate_surface.Normal, Amplitude="0.05")
series_4 = Series(Start=analysisperiod.hoys, Step=1, Count="10")  # -> flatten(Series)
extrude = Extrude(Base=flatten_tree_2, Direction=amplitude_2)
simple_mesh = SimpleMesh(Brep=flatten_tree_2)
panel_19 = Panel(series_4)
graft_tree_2 = GraftTree(Tree=series_4, IncludeEmptyLists=True, IncludeNullItems=True)  # -> simplify(Tree)
list_item_12 = ListItem(List=graft_tree_2, Index=0, Wrap=True)
skymatrix = LBCumulativeSkyMatrix(
    location=importepw.location,
    direct_rad=importepw.direct_normal_rad,
    diffuse_rad=importepw.diffuse_horizontal_rad,
    hoys=list_item_12)  # -> out, sky_mtx; plug-in component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
mesh_join = MeshJoin(Meshes=simple_mesh)

# ---- group: Try directly Connect OV
area_10 = Area(Geometry=mesh_join)  # -> Area, Centroid; disabled
panel_20 = Panel("-1")  # disabled
list_item_13 = ListItem(List=area_10.Centroid, Index=0, Wrap=True)  # disabled
list_item_14 = ListItem(List=area_10.Centroid, Index=panel_20, Wrap=True)  # disabled
deconstruct = Deconstruct(Point=area_10.Centroid)  # -> XComponent, YComponent, ZComponent; disabled
deconstruct_2 = Deconstruct(Point=list_item_14)  # -> XComponent, YComponent, ZComponent; disabled
deconstruct_3 = Deconstruct(Point=list_item_13)  # -> XComponent, YComponent, ZComponent; disabled
gradient = Gradient(
    LowerLimit=deconstruct_3.YComponent,
    UpperLimit=deconstruct_2.YComponent,
    Parameter=deconstruct.YComponent,
    stops=[0: RGB(243, 57, 0), 0.1: RGB(236, 27, 60), 0.2: RGB(210, 0, 118), 0.3: RGB(103, 0, 120), 0.4: RGB(39, 72, 161), 0.5: RGB(1, 192, 229), 0.6: RGB(18, 178, 90), 0.7: RGB(79, 186, 8), 0.8: RGB(220, 237, 32), 0.9: RGB(247, 159, 20), 1: RGB(243, 57, 0)])  # disabled
omnimaterial = OmniMaterial(MaterialOperand=False, material="Gray Glass")  # disabled
graft_tree_3 = GraftTree(Tree=mesh_join, IncludeEmptyLists=True, IncludeNullItems=True)  # disabled
graft_tree_4 = GraftTree(Tree=gradient, IncludeEmptyLists=True, IncludeNullItems=True)  # disabled
panel_21 = Panel("Sunlight Panel")  # disabled
panel_22 = Panel(omnimaterial)  # disabled
omnimeshseparate = OmniMeshSeparate(Geometry=mesh_join, LayerName=panel_21, Material=gradient, AttachMaterialToMesh=False, objectID=104002958)  # disabled
omnimeshseparate_2 = OmniMeshSeparate(Geometry=graft_tree_3, LayerName=panel_21, Material=graft_tree_4, AttachMaterialToMesh=False, objectID=104002957)  # disabled
omnimeshgroup = OmniMeshGroup(Geometry=mesh_join, LayerName=panel_21, Material=omnimaterial, AttachMaterialToMesh=False, objectID=104005183)  # disabled
panel_23 = Panel(gradient)  # disabled

# ----
panel_24 = Panel(skymatrix.sky_mtx)
incidentradiation = LBIncidentRadiation(sky_mtx=skymatrix.sky_mtx, geometry=flatten(simple_mesh), grid_size="1", legend_par=legendpar, run=Toggle(True))  # -> out, simplify(points), simplify(results), total, flatten(mesh), legend, title, int_mtx; plug-in component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

# ---- group: Try directly Connect OV / Color Mesh
custom_preview = CustomPreview(Geometry=mesh_join, Material=gradient)  # disabled

# ----
flatten_tree_3 = FlattenTree(Tree=incidentradiation.mesh, Path="{0}")
panel_25 = Panel(flatten_tree_3)
series_5 = Series(Start=0, Step="30", Count="10")
param_viewer = ParamViewer()
flip_mesh = FlipMesh(Mesh=flatten_tree_3, VertexNormals=True, FaceNormals=True, FaceOrientation=True)
panel_26 = Panel(series_5)

hours = Slider(0, range=0..23)
list_item_15 = ListItem(List=flatten_tree_3, Index=hours, Wrap=False)

deconstruct_mesh = DeconstructMesh(Mesh=flip_mesh)  # -> Vertices, Faces, Colours, Normals
omnimeshsimexporter = OmniMeshSimExporter(
    Mesh=flip_mesh,
    Colors=deconstruct_mesh.Colours,
    Points=incidentradiation.points,
    Data=incidentradiation.results,
    Timestamps=series_5,
    LayerName="SunRadiationSim",
    Units="kW/h",
    objectID=103959909)
omnimaterial_2 = OmniMaterial(MaterialOperand=False, material="Paper")
omnimeshseparate_3 = OmniMeshSeparate(Geometry=geometry, LayerName="SunRadiationSim", Material=omnimaterial_2, AttachMaterialToMesh=False, objectID=221842134)
omnibrowser = OmniBrowser(BrowseOperand=True, SignInOperand=True, objectID=103944462)  # -> ActiveServer, ProjectPropPath, ChildName
merge_5 = Merge(Data1=omnimeshseparate_3, Data2=omnimeshsimexporter)  # -> flatten(Result)
omnigrasshopper = OmniGrasshopper(
    OmniInput=merge_5,
    ProjectPropPath=omnibrowser.ProjectPropPath,
    ChildName=omnibrowser.ChildName,
    PropOperand=True,
    PublishOperand=False,
    SendToViewOperand=False)
